# Grasshopper definition BasicGcodeGenerator.gh (Grasshopper 1.0.7)
# Copyright: Copyright Alexander Curth
# Copyright: Use it.  Mod it.  Share it. Just please give credit and kepp this party going.
# Copyright: Use it.  Mod it.  Share it. Just please give credit and keep this party going.
# plug-ins: Bifocals

layer_height = Slider(2, range=0..10)
division_count = Slider(100, range=0..100)
extrusion_multiplier = Slider(5, range=0..10)
print_speed = Slider(1500, range=0..10000)

cylinder = Cylinder(Base=PlaneXY(0, 0, 0), Radius=Slider(50, range=0..100), Length=Slider(100, range=0..100))
contour = Contour(Shape=cylinder, Point=Point(0, 0, 0), Direction=Vector(0, 0, 1), Distance=layer_height)
divide_curve = DivideCurve(Curve=contour, Count=division_count, Kinks=False)  # -> Points, Tangents, Parameters
panel = Panel("""M107
M190 S50 ; set bed temperature and wait for it to be reached
M104 S41 ; set temperature
G28 ; home all axes
G1 Z5 F5000 ; lift nozzle

; Filament gcode

M109 S41 ; set temperature and wait for it to be reached
G21 ; set units to millimeters
G90 ; use absolute coordinates
M82 ; use absolute distances for extrusion
G92 E0
G92 E0
G1 Z0.350 F7800.000
G1 E-2.00000 F2400.00000
G92 E0
G1 X5.141 Y-66.147 F7800.000
G1 E2.00000 F2400.00000
G1 F1800""")
panel_2 = Panel("""M400
M107
M104 S0
G28 X0 Y0
M84""")
polyline = PolyLine(Vertices=flatten(divide_curve.Points), Closed=False)
curves_to_gcode = CurvesToGcode(
    gcode_header=panel,
    curve_geometry=flatten(polyline),
    extrusion_multiplier=extrusion_multiplier,
    gcode_end=panel_2,
    layer_height_mm=layer_height,
    print_speed_mm_min=print_speed)  # -> pt_2, printer_lines_as_polylines, g_code, printer_lines_as_polylines_2, pt_4, total_filament_extruded_mm
panel_3 = Panel(curves_to_gcode.g_code)

# ==== cluster CurvesToGcode
print_speed_mm_min = ClusterInput()
layer_height_mm = ClusterInput()
extrusion_multiplier = ClusterInput()  # Extrusion Multiplier
curve_geometry = ClusterInput()  # input curve to trace
number_slider = Slider(3, range=0..10)
jimmi_f_pla = ConfigFilamentJimmiPLA(layer_height_mm=layer_height_mm)
config_filament = ConfigFilament(extrusion_multiplier=extrusion_multiplier, primary_config_for_3dp_f=jimmi_f_pla)  # -> printer_volume_domain_box_4, xy_tolerance_mm_4, layer_height_mm_4, extrusion_width_mm_4, filament_diameter_mm_4, extrusion_multiplier_4, extruder_temperature_c_4, print_speed_mm_sec_4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
crv = Curve(curve_geometry)
xy_tolerance_mm = Number(config_filament.xy_tolerance_mm_4)
xy_tolerance_mm_2 = Number(config_filament.xy_tolerance_mm_4)
crv_2 = Curve()

extr_rate = ExtrusionRateCalculator(
    layer_height=config_filament.primary_config_for_3dp_f_2,
    extrusion_width=config_filament.primary_config_for_3dp_f_2,
    filament_diameter=config_filament.primary_config_for_3dp_f_2,
    extrusion_mutiplier=Slider(0, range=0..1))
extrusion_travel_e_mm_1mm = Number(extr_rate)

extr_rate_2 = ExtrusionRateCalculator(
    layer_height=config_filament.primary_config_for_3dp_f_2,
    extrusion_width=config_filament.primary_config_for_3dp_f_2,
    filament_diameter=config_filament.primary_config_for_3dp_f_2,
    extrusion_mutiplier=config_filament.primary_config_for_3dp_f_2)
extrusion_travel_e_mm_1mm_2 = Number(extr_rate_2)

xy_rapid_speed_mm_min = Number(config_filament.xy_rapid_speed_mm_sec_4)  # disabled
z_rapid_speed_mm_min = Number(config_filament.z_rapid_speed_mm_sec_4)  # disabled

# ---- group: RetractNoExtrusion
print_speed_mm_min_2 = Number(print_speed_mm_min)

# ----
print_speed_mm_min_3 = Number(print_speed_mm_min)
multiplication = Multiplication(A=print_speed_mm_min_2, B=Slider(2, range=0..10))
panel = Panel("""M140 S60 
M104 T0 S0 
M190 S60 
G28 
G92 E0 
G1 Z0 F1000""")

# ---- group: default end commands
panel_2 = Panel("""M400
M107
M104 S0
G28
M84""")

# ----
gcode_header = ClusterInput()  # Gcode Header
gcode_end = ClusterInput()
panel_3 = Panel("""GTO  X80 Y80   F4000
GO E-100 F1000""")

# ---- group: points to gcode
topoly = CurveToPolyline(Curve=crv_2, ToleranceDistance=xy_tolerance_mm, ToleranceAngle=0)  # -> Polyline, Segments
explode = Explode(Curve=topoly.Polyline, Recursive=True)  # -> Segments, Vertices
pdecon = Deconstruct(Point=explode.Vertices)  # -> XComponent, YComponent, ZComponent

# ----
printer_lines_as_polylines = ClusterOutput(topoly.Polyline)  # polyline describing the path traveled by the printer.

# ---- group: determine extrusion amount
number_slider_2 = Slider(0, range=0..100)
len = Length(Curve=explode.Segments)
division = Division(A=len, B=extrusion_travel_e_mm_1mm)
ins = InsertItems(List=division, Item=number_slider_2, Indices=number_slider_2, Wrap=True)
ma = MassAddition(Input=ins)  # -> Result, PartialResults
trim = TrimTree(Tree=ma.PartialResults, Depth=1)

# ----
pt = Point(explode.Vertices)
pt_2 = ClusterOutput(pt)

# ---- group: points to gcode (continued)
format = Format(
    Format="G1 X{0:0.000} Y{1:0.000} Z{2:0.000} E{3:0.000}",
    Culture=127,
    Data0=pdecon.XComponent,
    Data1=pdecon.YComponent,
    Data2=pdecon.ZComponent,
    Data3=trim)

# ----
panel_4 = Panel(format)

# ---- group: RetractNoExtrusion / begin printing and set print speed
item = ListItem(List=format, Index="0", Wrap=True)
format_2 = Format(Format="{0} F{1}", Culture=127, Data0=item, Data1=multiplication)
panel_5 = Panel(format_2)

# ---- group: RetractNoExtrusion / continue printing
split = SplitList(List=format, Index="1")  # -> ListA, ListB
trim_2 = TrimTree(Tree=split.ListB, Depth=1)
panel_6 = Panel(trim_2)

# ----
merge = Merge(Data1=format_2, Data2=trim_2)  # -> flatten(Result)

# ---- group: points to gcode
topoly_2 = CurveToPolyline(Curve=crv, ToleranceDistance=xy_tolerance_mm_2, ToleranceAngle=0)  # -> Polyline, Segments
explode_2 = Explode(Curve=topoly_2.Polyline, Recursive=True)  # -> Segments, Vertices
pdecon_2 = Deconstruct(Point=explode_2.Vertices)  # -> XComponent, YComponent, ZComponent

# ----
printer_lines_as_polylines_2 = ClusterOutput(topoly_2.Polyline)  # polyline describing the path traveled by the printer.
pt_3 = Point(explode_2.Vertices)

# ---- group: determine extrusion amount
number_slider_3 = Slider(0, range=0..100)
len_2 = Length(Curve=explode_2.Segments)
division_2 = Division(A=len_2, B=extrusion_travel_e_mm_1mm_2)
ins_2 = InsertItems(List=division_2, Item=number_slider_3, Indices=number_slider_3, Wrap=True)
ma_2 = MassAddition(Input=ins_2)  # -> Result, PartialResults
trim_3 = TrimTree(Tree=ma_2.PartialResults, Depth=1)

# ----
pt_4 = ClusterOutput(pt_3)

# ---- group: For Reference: total mm of filament used
ma_3 = MassAddition(Input=flatten(ins_2))  # -> Result, PartialResults; disabled
panel_7 = Panel(ma_3.Result)  # disabled

# ----
total_filament_extruded_mm = ClusterOutput(ma_3.Result)  # estimate of the total amount of filament needed to complete this section of g code; disabled

# ---- group: points to gcode (continued)
format_3 = Format(
    Format="G1 X{0:0.000} Y{1:0.000} Z{2:0.000} E{3:0.000}",
    Culture=127,
    Data0=pdecon_2.XComponent,
    Data1=pdecon_2.YComponent,
    Data2=pdecon_2.ZComponent,
    Data3=trim_3)

# ---- group: add in extrusions, speeds, and layer changes / begin printing and set print speed
item_2 = ListItem(List=format_3, Index="1", Wrap=True)
format_4 = Format(Format="{0} F{1}", Culture=127, Data0=item_2, Data1=print_speed_mm_min_3)
panel_8 = Panel(format_4)

# ---- group: add in extrusions, speeds, and layer changes / move up in z at rapid speed
panel_9 = Panel("G1 Z{0} F{1}")  # disabled
item_3 = ListItem(List=pdecon_2.ZComponent, Index=0, Wrap=True)  # disabled
format_5 = Format(Format=panel_9, Culture=127, Data0=item_3, Data1=z_rapid_speed_mm_min)  # disabled
panel_10 = Panel(format_5)  # disabled

# ---- group: add in extrusions, speeds, and layer changes / retract at retraction speed
retraction_speed_mm_min = Number(config_filament.retraction_speed_mm_sec_4)  # disabled
retraction_distance_mm = Number(config_filament.retraction_distance_mm_4)  # disabled
panel_11 = Panel("G1 F{0} E-{1}")  # disabled
format_6 = Format(Format=panel_11, Culture=127, Data0=retraction_speed_mm_min, Data1=retraction_distance_mm)  # disabled
long = LongestList(ListA=format_6, ListB=format_5, PaddingMode=2)  # -> ListA, ListB; disabled
panel_12 = Panel(long.ListA)  # disabled

# ---- group: add in extrusions, speeds, and layer changes / move to first XY position at rapid speed
panel_13 = Panel("G1 X{0} Y{1} F{2}")  # disabled
item_4 = ListItem(List=pdecon_2.XComponent, Index=0, Wrap=True)  # disabled
item_5 = ListItem(List=pdecon_2.YComponent, Index=0, Wrap=True)  # disabled
format_7 = Format(Format=panel_13, Culture=127, Data0=item_4, Data1=item_5, Data2=xy_rapid_speed_mm_min)  # disabled
panel_14 = Panel(format_7)  # disabled

# ---- group: add in extrusions, speeds, and layer changes / un-retract filament at retraction speed
panel_15 = Panel("G1 E0 F{0}")  # disabled
format_8 = Format(Format=panel_15, Culture=127, Data0=print_speed_mm_min_3)  # disabled
long_2 = LongestList(ListA=format_8, ListB=format_5, PaddingMode=2)  # -> ListA, ListB; disabled
panel_16 = Panel(long_2.ListA)  # disabled

# ---- group: add in extrusions, speeds, and layer changes / reset extruder to 0
panel_17 = Panel("G92 E0")  # disabled
long_3 = LongestList(ListA=panel_17, ListB=format_5, PaddingMode=2)  # -> ListA, ListB; disabled

# ---- group: add in extrusions, speeds, and layer changes / continue printing
split_2 = SplitList(List=format_3, Index="2")  # -> ListA, ListB
trim_4 = TrimTree(Tree=split_2.ListB, Depth=1)
panel_18 = Panel(trim_4)

# ----
merge_2 = Merge(Data1=long_3.ListA, Data2=long.ListA, Data3=format_7, Data4=format_5, Data5=long_2.ListA, Data6=format_4, Data7=trim_4)  # -> flatten(Result)
panel_19 = Panel(merge_2)

start_and_end_g_code = Data(gcode_header)

panel_20 = Panel(start_and_end_g_code)
item_6 = ListItem(List=flatten(start_and_end_g_code), Index=0, Wrap=True)

# ---- group: split into start and end g code
split_3 = SplitTree(Data=start_and_end_g_code, Masks=flatten("{1}"))  # -> Positive, Negative
start_g_code = Data(start_and_end_g_code)
end_g_code = Data(gcode_end)

# ---- group: if passed boolean true (=1)
lng = ListLength(List=flatten(start_and_end_g_code))
bool = Boolean(flatten(item_6))
smaller = SmallerThan(FirstNumber=lng, SecondNumber=1)  # -> SmallerThan, OrEqualTo
and = GateAnd(A=bool, B=smaller.OrEqualTo)

# ---- group: if passed g code (=2)
lng_2 = ListLength(List=flatten(start_and_end_g_code))
larger = LargerThan(FirstNumber=lng_2, SecondNumber=1)  # -> LargerThan, OrEqualTo
and_2 = GateAnd(B=larger.LargerThan)
multiplication_2 = Multiplication(A=and_2, B=2)

# ----
addition = Addition(A=and, B=multiplication_2)

# ---- group: start code
filter = StreamFilter(Gate=addition, Stream2=start_g_code)  # -> flatten(Stream); disabled

# ---- group: end code
filter_2 = StreamFilter(Gate=addition, Stream1=gcode_end, Stream2=gcode_end)  # -> flatten(Stream)

# ----
merge_3 = Merge(Data1=start_g_code, Data2=merge_2, Data3=filter_2)
panel_21 = Panel(merge_3)
g_code = ClusterOutput(merge_3)  # Complete g code for printing a single wall model with no infill

# ==== cluster ConfigFilament: This component holds the primary configurations needed for 3D printing on a standard filimant-based printer. These settings can be passed to or from this component as a condensed list. Settings can also be broken out and fed into Xylinus sub-routines. Setting can be modified through the specific inputs, which will override the condensed config input.

printer_volume_domain_box = ClusterInput()  # Input a box with X,Y,and Z domains that match the dimensions of your printer. This can easily be created with the Domain Box component. If your printer 0 position is in the bottom left corner (as standard) you can simply use the default world XY plane, and just enter the the dimesions of your printer into the X, Y, and Z inputs.
retraction_speed_mm_sec = ClusterInput()
xy_rapid_speed_mm_sec = ClusterInput()
extruder_temperature_c = ClusterInput()
retraction_distance_mm = ClusterInput()
filament_diameter_mm = ClusterInput()
z_rapid_speed_mm_sec = ClusterInput()
extrusion_width_mm = ClusterInput()
print_speed_mm_sec = ClusterInput()
extrusion_multiplier = ClusterInput()
xy_tolerance_mm = ClusterInput()
layer_height_mm = ClusterInput()
xy_tolerance_mm_2 = Number(xy_tolerance_mm)
layer_height_mm_2 = Number(layer_height_mm)
extrusion_multiplier_2 = Number(extrusion_multiplier)
print_speed_mm_sec_2 = Number(print_speed_mm_sec)
extrusion_width_mm_2 = Number(extrusion_width_mm)
z_rapid_speed_mm_sec_2 = Number(z_rapid_speed_mm_sec)
xy_rapid_speed_mm_sec_2 = Number(xy_rapid_speed_mm_sec)
extruder_temperature_c_2 = Number(extruder_temperature_c)
retraction_distance_mm_2 = Number(retraction_distance_mm)
filament_diameter_mm_2 = Number(filament_diameter_mm)
retraction_speed_mm_sec_2 = Number(retraction_speed_mm_sec)
printer_volume_domain_box_2 = Box(printer_volume_domain_box)
retraction_speed_mm_min = Number(expr("x*60", retraction_speed_mm_sec_2))
xy_rapid_speed_mm_min = Number(expr("x*60", xy_rapid_speed_mm_sec_2))
z_rapid_speed_mm_min = Number(expr("x*60", z_rapid_speed_mm_sec_2))
print_speed_mm_min = Number(expr("x*60", print_speed_mm_sec_2))

primary_config_for_3dp_f = ClusterInput()  # Optional configuration for 3D printing with filament. Direct entries will override these config entries.

panel = Panel("""Config Filament
printer volume domain box
XY tolerance (mm)
layer height (mm)
extrusion width (mm)
filament diameter (mm)
extrusion multiplier 
extruder temperature (C)
print speed (mm/sec)
XY rapid speed (mm/sec)
Z rapid speed (mm/sec)
retraction speed (mm/sec)
retraction distance (mm)""")
list = ValueList({"0", "1", "2", "3", "4", "5", "6", "7", "8", "9", "10", "11", "12", "13", "14", "15", "16", "17", "18", "19", "20"}, selected="0")
set_pass = SettingPasser(setting=panel, config=primary_config_for_3dp_f, setting_number=list)
config_type = Text(set_pass)

list_2 = ValueList({"0", "1", "2", "3", "4", "5", "6", "7", "8", "9", "10", "11", "12", "13", "14", "15", "16", "17", "18", "19", "20"}, selected="2")
list_3 = ValueList({"0", "1", "2", "3", "4", "5", "6", "7", "8", "9", "10", "11", "12", "13", "14", "15", "16", "17", "18", "19", "20"}, selected="4")
list_4 = ValueList({"0", "1", "2", "3", "4", "5", "6", "7", "8", "9", "10", "11", "12", "13", "14", "15", "16", "17", "18", "19", "20"}, selected="5")
list_5 = ValueList({"0", "1", "2", "3", "4", "5", "6", "7", "8", "9", "10", "11", "12", "13", "14", "15", "16", "17", "18", "19", "20"}, selected="6")
list_6 = ValueList({"0", "1", "2", "3", "4", "5", "6", "7", "8", "9", "10", "11", "12", "13", "14", "15", "16", "17", "18", "19", "20"}, selected="7")
list_7 = ValueList({"0", "1", "2", "3", "4", "5", "6", "7", "8", "9", "10", "11", "12", "13", "14", "15", "16", "17", "18", "19", "20"}, selected="8")
list_8 = ValueList({"0", "1", "2", "3", "4", "5", "6", "7", "8", "9", "10", "11", "12", "13", "14", "15", "16", "17", "18", "19", "20"}, selected="10")
list_9 = ValueList({"0", "1", "2", "3", "4", "5", "6", "7", "8", "9", "10", "11", "12", "13", "14", "15", "16", "17", "18", "19", "20"}, selected="11")
list_10 = ValueList({"0", "1", "2", "3", "4", "5", "6", "7", "8", "9", "10", "11", "12", "13", "14", "15", "16", "17", "18", "19", "20"}, selected="12")
list_11 = ValueList({"0", "1", "2", "3", "4", "5", "6", "7", "8", "9", "10", "11", "12", "13", "14", "15", "16", "17", "18", "19", "20"}, selected="13")  # disabled
list_12 = ValueList({"0", "1", "2", "3", "4", "5", "6", "7", "8", "9", "10", "11", "12", "13", "14", "15", "16", "17", "18", "19", "20"}, selected="14")  # disabled
list_13 = ValueList({"0", "1", "2", "3", "4", "5", "6", "7", "8", "9", "10", "11", "12", "13", "14", "15", "16", "17", "18", "19", "20"}, selected="15")  # disabled
list_14 = ValueList({"0", "1", "2", "3", "4", "5", "6", "7", "8", "9", "10", "11", "12", "13", "14", "15", "16", "17", "18", "19", "20"}, selected="1")
list_15 = ValueList({"0", "1", "2", "3", "4", "5", "6", "7", "8", "9", "10", "11", "12", "13", "14", "15", "16", "17", "18", "19", "20"}, selected="3")
list_16 = ValueList({"0", "1", "2", "3", "4", "5", "6", "7", "8", "9", "10", "11", "12", "13", "14", "15", "16", "17", "18", "19", "20"}, selected="9")
set_pass_2 = SettingPasser(setting=xy_tolerance_mm_2, config=primary_config_for_3dp_f, setting_number=list_2)
set_pass_3 = SettingPasser(setting=extrusion_width_mm_2, config=primary_config_for_3dp_f, setting_number=list_3)
set_pass_4 = SettingPasser(setting=filament_diameter_mm_2, config=primary_config_for_3dp_f, setting_number=list_4)
set_pass_5 = SettingPasser(setting=extrusion_multiplier_2, config=primary_config_for_3dp_f, setting_number=list_5)
set_pass_6 = SettingPasser(setting=extruder_temperature_c_2, config=primary_config_for_3dp_f, setting_number=list_6)
set_pass_7 = SettingPasser(setting=print_speed_mm_min, config=primary_config_for_3dp_f, setting_number=list_7)
set_pass_8 = SettingPasser(setting=z_rapid_speed_mm_min, config=primary_config_for_3dp_f, setting_number=list_8)
set_pass_9 = SettingPasser(setting=retraction_speed_mm_min, config=primary_config_for_3dp_f, setting_number=list_9)
set_pass_10 = SettingPasser(setting=retraction_distance_mm_2, config=primary_config_for_3dp_f, setting_number=list_10)
set_pass_11 = SettingPasser(config=primary_config_for_3dp_f, setting_number=list_11)  # disabled
set_pass_12 = SettingPasser(config=primary_config_for_3dp_f, setting_number=list_12)  # disabled
set_pass_13 = SettingPasser(config=primary_config_for_3dp_f, setting_number=list_13)  # disabled
set_pass_14 = SettingPasser(setting=printer_volume_domain_box_2, config=primary_config_for_3dp_f, setting_number=list_14)
set_pass_15 = SettingPasser(setting=layer_height_mm_2, config=primary_config_for_3dp_f, setting_number=list_15)
set_pass_16 = SettingPasser(setting=xy_rapid_speed_mm_min, config=primary_config_for_3dp_f, setting_number=list_16)

printer_volume_domain_box_3 = Box(set_pass_14)
retraction_speed_mm_sec_3 = Number(set_pass_9)
xy_rapid_speed_mm_sec_3 = Number(set_pass_16)
extruder_temperature_c_3 = Number(set_pass_6)
retraction_distance_mm_3 = Number(set_pass_10)
filament_diameter_mm_3 = Number(set_pass_4)
z_rapid_speed_mm_sec_3 = Number(set_pass_8)
extrusion_width_mm_3 = Number(set_pass_3)
print_speed_mm_sec_3 = Number(set_pass_7)
extrusion_multiplier_3 = Number(set_pass_5)
xy_tolerance_mm_3 = Number(set_pass_2)
layer_height_mm_3 = Number(set_pass_15)
printer_volume_domain_box_4 = ClusterOutput(printer_volume_domain_box_3)
xy_tolerance_mm_4 = ClusterOutput(xy_tolerance_mm_3)
layer_height_mm_4 = ClusterOutput(layer_height_mm_3)
extrusion_width_mm_4 = ClusterOutput(extrusion_width_mm_3)
filament_diameter_mm_4 = ClusterOutput(filament_diameter_mm_3)
extrusion_multiplier_4 = ClusterOutput(extrusion_multiplier_3)
extruder_temperature_c_4 = ClusterOutput(extruder_temperature_c_3)
print_speed_mm_sec_4 = ClusterOutput(print_speed_mm_sec_3)
xy_rapid_speed_mm_sec_4 = ClusterOutput(xy_rapid_speed_mm_sec_3)
z_rapid_speed_mm_sec_4 = ClusterOutput(z_rapid_speed_mm_sec_3)
retraction_speed_mm_sec_4 = ClusterOutput(retraction_speed_mm_sec_3)
retraction_distance_mm_4 = ClusterOutput(retraction_distance_mm_3)

data = Data([config_type, printer_volume_domain_box_3, xy_tolerance_mm_3, layer_height_mm_3, extrusion_width_mm_3, filament_diameter_mm_3, extrusion_multiplier_3, extruder_temperature_c_3, print_speed_mm_sec_3, xy_rapid_speed_mm_sec_3, z_rapid_speed_mm_sec_3, retraction_speed_mm_sec_3, retraction_distance_mm_3])
primary_config_for_3dp_f_2 = ClusterOutput(data)  # primary configurations for 3D printing with filament

# ==== cluster ExtrusionRateCalculator: calculate basic extrusion rate as factored by the cross section area of the filament and that of the print extrusion. (pi * (filament diameter/2)sq / (extrusion width * layer height)) * extrusion multiplier
layer_height = ClusterInput()  # Layer Height or a Xylinus Filimant Config
extrusion_width = ClusterInput()  # Extrusion Width or a Xylinus Filimant Config
filament_diameter = ClusterInput()  # Layer Height or a Xylinus Filimant Config
extrusion_mutiplier = ClusterInput()  # Extrusion Mulitplier or a Xylinus Filimant Config
setting = SettingChooser(config_or_setting=layer_height, config_item=3)
setting_2 = SettingChooser(config_or_setting=extrusion_width, config_item=4)
setting_3 = SettingChooser(config_or_setting=filament_diameter, config_item=5)
setting_4 = SettingChooser(config_or_setting=extrusion_mutiplier, config_item=6)
eval = Evaluate(F="((π*(f/2)²) / (h*w))/m", h=setting, w=setting_2, f=setting_3, m=setting_4)
extrusion_rate_e_mm_1_mm_travel = ClusterOutput(eval)

# ==== cluster ConfigFilamentJimmiPLA: Double-click to edit this blank starter config. This can then be saved as a new user object for future use.
layer_height_mm = ClusterInput()
extrusion_multiplier = Slider(1, range=0..2)
retraction_distance = Slider(0, range=0..10)
retraction_speed = Slider(0, range=0..200)
xy_rapid_speed = Slider(0, range=0..200)
extruder_temp = Slider(0, range=0..375)
z_rapid_speed = Slider(60, range=0..200)
xy_tolerance = Slider(0.12, range=0..1)
x_dimension = Slider(300, range=0..500)
y_dimension = Slider(270, range=0..500)
z_dimension = Slider(100, range=0..500)
print_speed = Slider(25, range=0..200)
box = DomainBox(Base=PlaneXY(0, 0, 0), X=x_dimension, Y=y_dimension, Z=z_dimension)
config_filament = ConfigFilament(
    printer_volume_domain_box=box,
    xy_tolerance_mm=xy_tolerance,
    layer_height_mm=layer_height_mm,
    extrusion_width_mm=layer_height_mm,
    filament_diameter_mm=layer_height_mm,
    extrusion_multiplier=extrusion_multiplier,
    extruder_temperature_c=extruder_temp,
    print_speed_mm_sec=print_speed,
    xy_rapid_speed_mm_sec=xy_rapid_speed,
    z_rapid_speed_mm_sec=z_rapid_speed,
    retraction_speed_mm_sec=retraction_speed,
    retraction_distance_mm=retraction_distance)  # -> printer_volume_domain_box_4, xy_tolerance_mm_4, layer_height_mm_4, extrusion_width_mm_4, filament_diameter_mm_4, extrusion_multiplier_4, extruder_temperature_c_4, print_speed_mm_sec_4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
primary_config_for_3dp_f = ClusterOutput(config_filament.primary_config_for_3dp_f_2)  # primary configurations for 3D printing with filament

# ==== cluster SettingPasser: If an individual specific setting is input in S, it will be returned. Otherwise the config (C) setting, matching the input ID will be passed. The ID is an integer matching the branch number of the desired setting. The returned setting will have the data structure matching the input ID.
setting = ClusterInput()  # Individual specific setting. Will override the config setting.
config = ClusterInput()
setting_number = ClusterInput()  # input an integer matching the branch number of the desired setting.
data = Data(config)
int = Integer(setting_number)
data_2 = Data(setting)
path = ConstructPath(Indices=int)
null = NullItem(Item=data_2)  # -> NullFlags, InvalidFlags, Description
branch = TreeBranch(Tree=data, Path=path, MaintainPaths=True)
filter = StreamFilter(Gate=null.NullFlags, Stream0=data_2, Stream1=branch)
replace = ReplacePaths(Data=flatten(filter), Search="{0}", Replace=path)
setting_2 = ClusterOutput(replace)

# ==== cluster SettingChooser: input a config and select the desired setting. If a setting is entered and not a config, then that setting is simply passed.
config_or_setting = ClusterInput()  # input a Xylinus config or just the particular setting needed
config_item = ClusterInput()  # To select differrent item indexes for different config types, input a list of integers in this sequence 0) filament, 1) syringe, 2) inket, 3) DLP
data = Data(config_or_setting)

# ---- group: is it a config?
branch = TreeBranch(Tree=data, Path="{0}", MaintainPaths=True)
tmatch = MatchText(Text=branch, RegEx="config", Case=False)
int = Integer(tmatch)

# ---- group: what type of config?
split = TextSplit(Text=branch, Separators=" ")
panel = Panel("""Filament
Syringe
InkJet
DLP""")
item = ListItem(List=split, Index=1, Wrap=True)
mindex = MemberIndex(Set=panel, Member=item)  # -> Index, Count

# ----
int_2 = Integer(config_item)
long = LongestList(ListA=panel, ListB=int_2, PaddingMode=2)  # -> ListA, ListB

# ---- group: pull the selected item for the supplied config
item_2 = ListItem(List=long.ListB, Index=0, Wrap=False)  # -> Item, Item1, Item2, Item3
filter = StreamFilter(Gate=mindex.Index, Stream0=item_2.Item, Stream1=item_2.Item1, Stream2=item_2.Item2, Stream3=item_2.Item3)

# ----
path = ConstructPath(Indices=filter)
branch_2 = TreeBranch(Tree=data, Path=path, MaintainPaths=True)
filter_2 = StreamFilter(Gate=int, Stream0=data, Stream1=branch_2)
data_2 = Data(filter_2)
setting = ClusterOutput(data_2)  # export the particular setting for a Xylius config. If a config was not input, then it simply passes the input setting.
